# Grasshopper definition robot.ghx (Grasshopper 1.0.8)

ros_connect = Python3Script(connect=Toggle(True))  # -> out, ros_client, is_connected
# ---------- ros_connect: Python ----------
# r: git+https://github.com/compas-dev/compas_fab.git@wip_process, git+https://github.com/compas-dev/compas_robots.git@main
# venv: fab_wip
import Grasshopper
from compas_ghpython import create_id
from scriptcontext import sticky as st

from compas_fab.backends import RosClient


class ROSConnect(Grasshopper.Kernel.GH_ScriptInstance):
    def RunScript(self, ip, port, connect):
        ros_client = None

        ip = ip or "127.0.0.1"
        port = port or 9090

        key = create_id(ghenv.Component, "ros_client")  # noqa: F821
        print("key", key)

        ros_client = st.get(key, None)

        if ros_client:
            st[key].close()
        if connect:
            st[key] = RosClient(ip, port)
            st[key].run(5)

        ros_client = st.get(key, None)
        is_connected = ros_client.is_connected if ros_client else False
        return (ros_client, is_connected)
# ---------- end ros_connect ----------
ros_robot = Python3Script(ros_client=ros_connect.ros_client, load=Toggle(True))  # -> out, robot, robot_cell_state
# ---------- ros_robot: Python ----------
# venv: fab_wip

import Grasshopper
from compas_ghpython import create_id
from scriptcontext import sticky as st

from compas.scene import SceneObject


class ROSRobot(Grasshopper.Kernel.GH_ScriptInstance):
    def RunScript(self, ros_client, load):
        key = create_id(ghenv.Component, "robot")

        if ros_client and ros_client.is_connected and load:
            robot_cell = ros_client.load_robot_cell(load_geometry=True)
            st[key] = robot_cell

        robot_cell = st.get(key, None)

        if robot_cell:
            all_joints = robot_cell.get_all_configurable_joints()
            for i in range(len(all_joints)):
                print(f"{all_joints[i].name}: {all_joints[i].limit.lower} / {all_joints[i].limit.upper}")

            robot_cell_state = robot_cell.default_cell_state()
        else:
            robot_cell_state = None

        print(f"Groups: {robot_cell.group_names}")
        return robot_cell, robot_cell_state
# ---------- end ros_robot ----------
visualize_robot_cell = Python3Script(robot_cell=ros_robot.robot, cell_state=ros_robot.robot_cell_state)  # -> out, native_geometry
# ---------- visualize_robot_cell: Python ----------
# venv: fab_wip
from scriptcontext import sticky
from compas_ghpython import create_id
from compas.scene import Scene

# Create hash (scope limited to this component) for caching SceneObject
object_hash = str(id(robot_cell))
gh_component = ghenv.Component
cache_id = create_id(gh_component, object_hash)

# If scene object exist in sticky, retrieve it
scene_object = None
if sticky.has_key(cache_id):
    scene_object = sticky[cache_id]
    # Double check if the item is the same
    if scene_object.item is robot_cell:
        print("SceneObject '{}' reused for '{}'".format(type(scene_object).__name__, type(robot_cell).__name__))
    else:
        scene_object = None

# Create Scene Object and cache it
if scene_object is None:
    scene = Scene()
    scene_object = scene.add(robot_cell)
    print("SceneObject {} newly created for {}".format(type(scene_object).__name__, type(robot_cell).__name__))
    sticky[cache_id] = scene_object

# The draw method is the same as before
native_geometry = scene_object.draw(cell_state)
# ---------- end visualize_robot_cell ----------
