# Grasshopper definition 01_fabricator.ghx (Grasshopper 1.0.8)

# ----
# Antikythera Receive
toggle = BooleanToggle(True)
fabrication_receiver = Python3Script(enabled=toggle)  # -> pending_task; inputs broker_host: String
# ---------- fabrication_receiver: Python ----------
# r: compas==2.15.1, timber_design==0.2.0, compas_eve
# venv: akt_agent

"""Fabrication Receiver — fabrication.gh

Listens for a 'fabrication.toolpaths' task from the orchestrator.
Outputs the TimberModel and task metadata for downstream toolpath generation.

Use the companion Fabrication Submit component to send computed toolpaths
back once they have been reviewed and approved. The two components share the
BackgroundWorker via sc.sticky keyed on task_type to avoid a GH loop.
"""
from compas_rhino.devtools import DevTools
DevTools.ensure_path()

import Grasshopper
import scriptcontext as sc

from compas_eve.ghpython import BackgroundWorker
from gh_agent import run_agent, stop_agent
from compas_ghpython import create_id
DEFAULT_TASK_TYPE = "fabrication.manager"

def print_sticky():
    for key, value in sc.sticky.items():
        if key.startswith("background"):
            print(f"worker - {value.launcher.launcher_id}")


class FabricationReceiverComponent(Grasshopper.Kernel.GH_ScriptInstance):
    def RunScript(self, broker_host: str, enabled):
        print(create_id(ghenv.Component, "background_worker"))
        broker_host = broker_host or "127.0.0.1"
        broker_port = 1883
        task_type = DEFAULT_TASK_TYPE
        print_sticky()
        # ── Stop ──────────────────────────────────────────────────────────────

        if not enabled:
            BackgroundWorker.stop_instance_by_component(ghenv)  # noqa: F821
            ghenv.Component.Message = "disabled"  # noqa: F821
            return None

        # ── BackgroundWorker ──────────────────────────────────────────────────
        # listetning starts
        worker = BackgroundWorker.instance_by_component(
            ghenv,  # noqa: F821
            run_agent,
            dispose_function=stop_agent,
            auto_set_done=False,
            args=(task_type, broker_host, broker_port, "FabricationAgent")
        )
    
        if not worker.is_working() and not worker.is_done():
            worker.start_work()
            ghenv.Component.Message = "starting…"  # noqa: F821
            return None

        # ── Expose task data ───────────────────────────────────────────────────
        pending_task = getattr(worker, "pending_task", None)
        print(pending_task)
        print(worker.launcher.transport._events)
        # if assigned task by antikythera
        if pending_task:
            # we got assigned a task by the orchestrator
            ghenv.Component.Message = "task received — generate toolpaths!"  # noqa: F821
            return pending_task            

        ghenv.Component.Message = "listening"  # noqa: F821
        return None
# ---------- end fabrication_receiver ----------
deconstruct_task = Python3Script(pending_task=fabrication_receiver)  # -> timber_model, beams
# ---------- deconstruct_task: Python ----------
# r: compas==2.15.1, timber_design==0.2.0, compas_eve
# venv: akt_agent
import System
import Rhino
import Grasshopper

import rhinoscriptsyntax as rs

from compas_rhino.conversions import point_to_rhino


class BeamLabel:
    def __init__(self, text, color, location, size):
        self.text = text
        self.color = color
        self.location = location
        self.size = size


class DeconstructTask(Grasshopper.Kernel.GH_ScriptInstance):
    def __init__(self):
        super().__init__()
        self._labels = []

    def RunScript(self, pending_task):
        timber_model = None        
        if pending_task:
            timber_model = pending_task.task_data["inputs"].get("timber_model")
        
        # Output geometry
        beams = []
        if timber_model:
            # TODO: consider removing this if too heavy and just serialize processings
            timber_model.process_joinery()

            geometry_errors = []
            for beam in timber_model.beams:
                try:
                    beams.append(beam.geometry)
                except Exception as e:
                    geometry_errors.append(e)
                    print(f"Could you add geometry of beam: {e}")
                self._labels.append(
                    BeamLabel(
                        text=str(beam.graphnode), 
                        color=System.Drawing.Color.White, 
                        location=point_to_rhino(beam.centerline.midpoint), 
                        size=24
                    )
                )

            if len(geometry_errors) > 0:
                ghenv.Component.Message = f"{len(geometry_errors)} beams failed to generate geometry!"

        return timber_model, beams

    def DrawViewportMeshes(self, args):
        # helps identifying the beams
        for label in self._labels:
            args.Display.Draw2dText(label.text, label.color, label.location, True, label.size)
# ---------- end deconstruct_task ----------

draw = COMPASDraw(cg=deconstruct_task.beams)  # -> rg
#   port cg: The COMPAS geometry or datastructure to be drawn.
#   port rg: The Rhino geometry object.
# ---------- draw: Python ----------
# r: compas==2.15.1, timber_design==0.2.0, compas_eve
# venv: akt_agent

from typing import Any

import Grasshopper

from compas.scene import SceneObject


class CompasToRhinoGeometry(Grasshopper.Kernel.GH_ScriptInstance):
    def RunScript(self, cg):
        if not cg:
            return None

        return SceneObject(item=cg).draw()
# ---------- end draw ----------
beams_from_model = Python3Script(model=deconstruct_task.timber_model)  # -> to_fabricate_beams, fabricated_beams
# ---------- beams_from_model: Python ----------
beams = None
if model:
    model.process_joinery()
    fabricated_beams = []
    to_fabricate_beams = []
    for beam in model.beams:
        if beam.attributes.get("is_fabricated", False):
            fabricated_beams.append(beam)
        else:
            to_fabricate_beams.append(beam)
# ---------- end beams_from_model ----------

# ----
# Select next beam to fabricate
number_slider = Slider(24, range=0..100)
beam_id = Panel("11")
beam = ListItem(List=beams_from_model.to_fabricate_beams, Index=number_slider, Wrap=True)

# ----
# Beam Preview
beam_preview = Python3Script(beam=beam)  # -> out, at_design, at_origin, blank
# ---------- beam_preview: Python ----------
from compas.geometry import Transformation
from compas.geometry import Frame

if beam:
    at_design = beam.geometry
    at_origin = beam.elementgeometry
    blank = beam.blank.transformed(Transformation.from_frame_to_frame(beam.frame, Frame.worldXY()))
    print(f"Beam no. {beam.graphnode}\nBlank length: {beam.blank_length}")
# ---------- end beam_preview ----------
draw_2 = COMPASDraw(cg=beam_preview.blank)  # -> rg; same code as draw
draw_3 = COMPASDraw(cg=beam_preview.at_origin)  # -> rg; same code as draw
draw_4 = COMPASDraw(cg=beam_preview.at_design)  # -> rg; same code as draw
wires = BrepWireframe(Brep=draw_2, Density=-1)
preview = CustomPreview(Geometry=wires, Material=ColourSwatch(SwatchColor=RGB(0, 0, 0)))
preview_2 = CustomPreview(Geometry=draw_3, Material=ColourSwatch(SwatchColor=RGB(168, 131, 168)))
preview_3 = CustomPreview(Geometry=draw_4, Material=ColourSwatch(SwatchColor=RGB(255, 0, 255)))
panel = Panel(beam_preview.out)

# ----
# Fabricated beams
beam_preview_2 = Python3Script(beam=beams_from_model.fabricated_beams)  # -> at_design
# ---------- beam_preview_2: Python ----------
if beam:
    at_design = beam.geometry
# ---------- end beam_preview_2 ----------
draw_5 = COMPASDraw(cg=beam_preview_2)  # -> rg; same code as draw
preview_4 = CustomPreview(Geometry=draw_5, Material=ColourSwatch(SwatchColor=RGBA(145, 145, 145, 236)))

# ----
# Set fabrication status
fab_status = Python3Script(timber_model=deconstruct_task.timber_model, beam=beam, beam_finished=Button(), set_next=Button())  # -> timber_model
# ---------- fab_status: Python ----------
if timber_model and beam:
    
    if beam_finished:
        beam.attributes["is_fabricated"] = True
        beam.attributes["is_next"] = False
    if set_next:
        # in case it was marked fabricated, reset
        beam.attributes["is_fabricated"] = False
        ghenv.Component.Message = "Marked beam fabricated!"  # noqa: F821
        
        # only one beam is allowed to be next, so reset all others
        for b in timber_model.beams:
            b.attributes["is_next"] = False
        
        beam.attributes["is_next"] = True
        ghenv.Component.Message = "Marked beam next!"  # noqa: F821
timber_model = timber_model
# ---------- end fab_status ----------
# Submit fabrication status
button = Button()
fabrication_receiver_2 = Python3Script(pending_task=fabrication_receiver, timber_model=fab_status, submit=button)  # -> status
# ---------- fabrication_receiver_2: Python ----------
# r: compas==2.15.1, timber_design==0.2.0, compas_eve
# venv: akt_agent

"""Fabrication Submit — fabrication_submit.gh

Companion to the Fabrication Receiver component.
Looks up the shared BackgroundWorker via sc.sticky (keyed on task_type),
accepts the computed toolpaths, and sends them back to the orchestrator
when submit is pulsed.

Wire toolpaths from your downstream toolpath generation logic and pulse
submit to approve and release them to the Robot agent.
"""

import Grasshopper
import scriptcontext as sc

from compas_rhino.conversions import plane_to_compas_frame

def all_beams_finished(model):
    return all([beam.attributes.get("is_fabricated", False) for beam in model.beams])

class FabricationSubmitComponent(Grasshopper.Kernel.GH_ScriptInstance):
    def RunScript(self, pending_task, timber_model, submit):
        print("ran!")
        print(getattr(pending_task, "event", None))
        if pending_task is None:
            ghenv.Component.Message = "no receiver"  # noqa: F821
            return "no_receiver"
        if submit and pending_task:
            has_beams = not all_beams_finished(timber_model)
            pending_task.task_outputs = {"timber_model": timber_model, "has_beams": has_beams}
            if pending_task.event:
                print("setting event!")
                pending_task.event.set()

            ghenv.Component.Message = "submitted"  # noqa: F821
            return "submitted"

        if pending_task:
            ghenv.Component.Message = "waiting for approval"  # noqa: F821
            return "pending"

        ghenv.Component.Message = "idle"  # noqa: F821
        return "idle"
# ---------- end fabrication_receiver_2 ----------
